# Grasshopper definition 001 - BuildGen.gh (Grasshopper 1.0.7)
# plug-ins: Python, Sasquatch

_1_1_neighborsetback = GetNumber(AtLeast=1, AtMost=1, Maximum=1.797693135e+308, Minimum=-1.797693135e+308, TreeAccess=False)
_1_2_roadsetback = GetNumber(AtLeast=1, AtMost=1, Maximum=1.797693135e+308, Minimum=-1.797693135e+308, TreeAccess=False)
_1_0_siteboundary = GetGeometry(AtLeast=1, AtMost=1, DeleteInput=False, Filter=1074004029, TreeAccess=False)
curve = Curve(_1_0_siteboundary)

# ---- group: SETBACKS
explode = Explode(Curve=curve, Recursive=True)  # -> Segments, Vertices
merge = Merge(
    Data1=_1_2_roadsetback,
    Data2=_1_1_neighborsetback,
    Data3=_1_1_neighborsetback,
    Data4=_1_2_roadsetback,
    Data5=_1_2_roadsetback)
offset_curve = OffsetCurve(Curve=explode.Segments, Distance=expr("X", merge), Corners=1)
multiple_curves = MultipleCurves(Curves=flatten(offset_curve))  # -> Points, IndexA, IndexB, ParamA, ParamB
list_item = ListItem(List=multiple_curves.Points, Index=0, Wrap=True)
sort_points_polar = SortPointsPolar(Points=multiple_curves.Points, ReferncePlane=list_item)  # -> SortedPoints, SortedValues
polyline = PolyLine(Vertices=sort_points_polar.SortedPoints, Closed=True)
point_list = PointList(Points=sort_points_polar.SortedPoints, Size=Slider(5, range=0..10))
join_curves = JoinCurves(Curves=polyline, Preserve=False)

# ----
_2_0_buildingpositionshuffle = GetInteger(AtLeast=1, AtMost=1, Maximum=2147483647, Minimum=-2147483648, TreeAccess=False)
crd = Panel("""0
0
2
2
0""")
d0 = Panel("""0
0
9
9
0""")
d1 = Panel("""0
0
9
9
0""")
area = Area(Geometry=curve)  # -> Area, Centroid
area_2 = Area(Geometry=join_curves)  # -> Area, Centroid
shift_list = ShiftList(List=d0, Shift=_2_0_buildingpositionshuffle, Wrap=True)
shift_list_2 = ShiftList(List=d1, Shift=_2_0_buildingpositionshuffle, Wrap=True)
shift_list_3 = ShiftList(List=crd, Shift=_2_0_buildingpositionshuffle, Wrap=True)
curve_check = CurveCheck(_curve=join_curves)
d0_2 = Panel(shift_list)
d1_2 = Panel(shift_list_2)
crd_2 = Panel(shift_list_3)
plot_area = Panel(area.Area)
buildable_area = Panel(area_2.Area)
context_print = ContextPrint(_11BuildableArea=buildable_area)
context_print_2 = ContextPrint(_10PlotArea=plot_area)
_3_0_lshapelength = GetNumber(AtLeast=1, AtMost=1, Maximum=1.797693135e+308, Minimum=-1.797693135e+308, TreeAccess=False)
_3_1_lshapeswitch = GetBoolean(AtLeast=1, AtMost=1, FalseValue="False", TreeAccess=False, TrueValue="True")
number_slider = Slider(0, range=0..100)
# FAR & GFA CALCULATIONS
_1_3_far = GetNumber(AtLeast=1, AtMost=1, Maximum=1.797693135e+308, Minimum=-1.797693135e+308, TreeAccess=False)
_4_4_maxstaircasedistance = GetNumber(AtLeast=1, AtMost=1, Maximum=1.797693135e+308, Minimum=-1.797693135e+308, TreeAccess=False)
_4_1_staircasewidth = GetNumber(AtLeast=1, AtMost=1, Maximum=1.797693135e+308, Minimum=-1.797693135e+308, TreeAccess=False)
_4_2_staircasedepth = GetNumber(AtLeast=1, AtMost=1, Maximum=1.797693135e+308, Minimum=-1.797693135e+308, TreeAccess=False)
_4_0_corridorsetback = GetNumber(AtLeast=1, AtMost=1, Maximum=1.797693135e+308, Minimum=-1.797693135e+308, TreeAccess=False)
_4_3_staircaseflip = GetBoolean(AtLeast=1, AtMost=1, FalseValue="False", TreeAccess=False, TrueValue="True")
l_building_system = LBuildingSystem(
    _buildable_area=curve_check,
    _unit_depth_0=d0_2,
    _unit_depth_1=d1_2,
    _corridor_width=crd_2,
    _L_building_length=_3_0_lshapelength,
    _switch=_3_1_lshapeswitch,
    _staircase_width=_4_1_staircasewidth,
    _staircase_depth=_4_2_staircasedepth,
    _staircase_flip=_4_3_staircaseflip,
    _max_stair_distance=_4_4_maxstaircasedistance)  # -> Building_Complexes_, L_Buildings_, Buildings_, Preview_
geometry = Geometry(l_building_system.Preview_)
area_3 = Area(Geometry=geometry)  # -> flatten(Area), Centroid
multiplication = Multiplication(PLOTAREA=plot_area, FAR=_1_3_far)
merge_2 = Merge(Data1=area_3.Area, Data2=number_slider)  # -> flatten(Result)
corridor_circulation_system = CorridorCirculationSystem(
    _Building=l_building_system.Buildings_,
    _corridor_setback=_4_0_corridorsetback,
    _staircase_width=_4_1_staircasewidth,
    _staircase_depth=_4_2_staircasedepth,
    _staircase_flip=_4_3_staircaseflip,
    _max_stair_distance=_4_4_maxstaircasedistance)  # -> Building_, Preview_
mass_addition = MassAddition(Input=merge_2)  # -> Result, PartialResults
mass_addition_2 = MassAddition(Input=flatten(area_3.Area))  # -> Result, PartialResults
required_gfa = Panel(multiplication)
pod_bldgs_first_gfa = Panel(mass_addition.Result)
only_bldgs_gfa_floor = Panel(mass_addition_2.Result)
subtraction = Subtraction(A=multiplication, B=number_slider)
req_gfa_after_pod = Panel(subtraction)
division = Division(A=subtraction, B=mass_addition_2.Result)
no_of_floors = Panel(division)
_6_1_unitdistributiontype = GetBoolean(AtLeast=1, AtMost=1, FalseValue="False", TreeAccess=False, TrueValue="True")
round = Round(Number=division)  # -> Nearest, Floor, Ceiling
multiplication_2 = Multiplication(A=round.Nearest, B=mass_addition_2.Result)
subtraction_2 = Subtraction(A=multiplication, B=multiplication_2, C=number_slider)
gfa_difference = Panel(subtraction_2)
mass_addition_3 = MassAddition(Input=flatten([number_slider, multiplication_2]))  # -> Result, PartialResults
actual_gfa = Panel(mass_addition_3.Result)
no_of_floors_2 = Panel(round.Nearest)
to_3d = To3D(
    MarshallingSignalParameter=flatten([corridor_circulation_system.Building_, l_building_system.L_Buildings_]),
    _number_of_floor=no_of_floors_2)  # -> Building_, Preview_
_5_1_programratio = GetString(AtLeast=1, AtMost=1, TreeAccess=True)
_5_0_programarea = GetString(AtLeast=1, AtMost=1, TreeAccess=True)
_6_0_unitrowslicingtype = GetBoolean(AtLeast=1, AtMost=1, FalseValue="False", TreeAccess=False, TrueValue="True")
_6_2_unitdistributionshuffle = GetNumber(AtLeast=1, AtMost=1, Maximum=1.797693135e+308, Minimum=-1.797693135e+308, TreeAccess=False)
unit_distribution = UnitDistribution(
    MarshallingSignalParameter=to_3d.Building_,
    _unit_sizes=_5_0_programarea,
    _unit_distribution=_5_1_programratio,
    _unit_row_slicing_type=_6_0_unitrowslicingtype,
    _unit_distribution_type=_6_1_unitdistributiontype,
    _shuffle=_6_2_unitdistributionshuffle)  # -> Building_, Preview_
context_print_3 = ContextPrint(_12NumberOfFloors=no_of_floors_2)
visualize_building = VisualizeBuilding(MarshallingSignalParameter=flatten(unit_distribution.Building_))  # -> Unit_geo_, Unit_color_, Corridor_geo_, Corridor_color_, flatten(Stair_Case_geo_), Stair_Case_color_, Amenity_Zone_geo_, Amenity_Zone_color_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
context_print_4 = ContextPrint(_21UnitColor=visualize_building.Unit_color_)
context_print_5 = ContextPrint(_23CorridorColor=visualize_building.Corridor_color_)
context_bake = ContextBake(_30UnitMidPoint=visualize_building.Unit_mid_point_)
context_print_6 = ContextPrint(_31UnitArea=visualize_building.Unit_area_)
context_bake_2 = ContextBake(_20UnitGeometry=visualize_building.Unit_geo_)
context_bake_3 = ContextBake(_22CorridorGeometry=visualize_building.Corridor_geo_)
context_bake_4 = ContextBake(_24StaircaseGeometry=visualize_building.Stair_Case_geo_)
context_print_7 = ContextPrint(_25StaircaseColor=visualize_building.Stair_Case_color_)
context_print_8 = ContextPrint(_32AreaTextColor=visualize_building.Area_text_color_)
