# Grasshopper definition 001 - BuildingGenerator - L Shape.gh (Grasshopper 1.0.7)
# plug-ins: Python, Sasquatch

neighborsetback = GetNumber(AtLeast=1, AtMost=1, Maximum=1.797693135e+308, Minimum=-1.797693135e+308, TreeAccess=False)
roadsetback = GetNumber(AtLeast=1, AtMost=1, Maximum=1.797693135e+308, Minimum=-1.797693135e+308, TreeAccess=False)
siteboundary = GetGeometry(AtLeast=1, AtMost=1, DeleteInput=False, Filter=1074004029, TreeAccess=False)
curve = Curve(siteboundary)

# ---- group: SETBACKS
explode = Explode(Curve=curve, Recursive=True)  # -> Segments, Vertices
merge = Merge(Data1=roadsetback, Data2=neighborsetback, Data3=neighborsetback, Data4=roadsetback, Data5=roadsetback)
offset_curve = OffsetCurve(Curve=explode.Segments, Distance=expr("X", merge), Corners=1)
multiple_curves = MultipleCurves(Curves=flatten(offset_curve))  # -> Points, IndexA, IndexB, ParamA, ParamB
list_item = ListItem(List=multiple_curves.Points, Index=0, Wrap=True)
sort_points_polar = SortPointsPolar(Points=multiple_curves.Points, ReferncePlane=list_item)  # -> SortedPoints, SortedValues
polyline = PolyLine(Vertices=sort_points_polar.SortedPoints, Closed=True)
point_list = PointList(Points=sort_points_polar.SortedPoints, Size=Slider(5, range=0..10))
join_curves = JoinCurves(Curves=polyline, Preserve=False)

# ----
buildingpositionshuffle = GetInteger(AtLeast=1, AtMost=1, Maximum=2147483647, Minimum=-2147483648, TreeAccess=False)
crd = Panel("""0
0
2
2
0""")
d0 = Panel("""0
0
9
9
0""")
d1 = Panel("""0
0
9
9
0""")
area = Area(Geometry=curve)  # -> Area, Centroid
area_2 = Area(Geometry=join_curves)  # -> Area, Centroid
shift_list = ShiftList(List=d0, Shift=buildingpositionshuffle, Wrap=True)
shift_list_2 = ShiftList(List=d1, Shift=buildingpositionshuffle, Wrap=True)
shift_list_3 = ShiftList(List=crd, Shift=buildingpositionshuffle, Wrap=True)
curve_check = CurveCheck(_curve=join_curves)
d0_2 = Panel(shift_list)
d1_2 = Panel(shift_list_2)
crd_2 = Panel(shift_list_3)
plot_area = Panel(area.Area)
buildable_area = Panel(area_2.Area)
context_print = ContextPrint(BuildableArea=buildable_area)
context_print_2 = ContextPrint(PlotArea=plot_area)
lshapelength = GetNumber(AtLeast=1, AtMost=1, Maximum=1.797693135e+308, Minimum=-1.797693135e+308, TreeAccess=False)
lshapeswitch = GetBoolean(AtLeast=1, AtMost=1, FalseValue="False", TreeAccess=False, TrueValue="True")
number_slider = Slider(0, range=0..100)
# FAR & GFA CALCULATIONS
far = GetNumber(AtLeast=1, AtMost=1, Maximum=1.797693135e+308, Minimum=-1.797693135e+308, TreeAccess=False)
maxstaircasedistance = GetNumber(AtLeast=1, AtMost=1, Maximum=1.797693135e+308, Minimum=-1.797693135e+308, TreeAccess=False)
staircasewidth = GetNumber(AtLeast=1, AtMost=1, Maximum=1.797693135e+308, Minimum=-1.797693135e+308, TreeAccess=False)
staircasedepth = GetNumber(AtLeast=1, AtMost=1, Maximum=1.797693135e+308, Minimum=-1.797693135e+308, TreeAccess=False)
corridorsetback = GetNumber(AtLeast=1, AtMost=1, Maximum=1.797693135e+308, Minimum=-1.797693135e+308, TreeAccess=False)
staircaseflip = GetBoolean(AtLeast=1, AtMost=1, FalseValue="False", TreeAccess=False, TrueValue="True")
l_building_system = LBuildingSystem(
    _buildable_area=curve_check,
    _unit_depth_0=d0_2,
    _unit_depth_1=d1_2,
    _corridor_width=crd_2,
    _L_building_length=lshapelength,
    _switch=lshapeswitch,
    _staircase_width=staircasewidth,
    _staircase_depth=staircasedepth,
    _staircase_flip=staircaseflip,
    _max_stair_distance=maxstaircasedistance)  # -> Building_Complexes_, L_Buildings_, Buildings_, Preview_
geometry = Geometry(l_building_system.Preview_)
area_3 = Area(Geometry=geometry)  # -> flatten(Area), Centroid
multiplication = Multiplication(PLOTAREA=plot_area, FAR=far)
merge_2 = Merge(Data1=area_3.Area, Data2=number_slider)  # -> flatten(Result)
corridor_circulation_system = CorridorCirculationSystem(
    _Building=l_building_system.Buildings_,
    _corridor_setback=corridorsetback,
    _staircase_width=staircasewidth,
    _staircase_depth=staircasedepth,
    _staircase_flip=staircaseflip,
    _max_stair_distance=maxstaircasedistance)  # -> Building_, Preview_
mass_addition = MassAddition(Input=merge_2)  # -> Result, PartialResults
mass_addition_2 = MassAddition(Input=flatten(area_3.Area))  # -> Result, PartialResults
required_gfa = Panel(multiplication)
pod_bldgs_first_gfa = Panel(mass_addition.Result)
only_bldgs_gfa_floor = Panel(mass_addition_2.Result)
subtraction = Subtraction(A=multiplication, B=number_slider)
req_gfa_after_pod = Panel(subtraction)
division = Division(A=subtraction, B=mass_addition_2.Result)
no_of_floors = Panel(division)
unitdistributiontype = GetBoolean(AtLeast=1, AtMost=1, FalseValue="False", TreeAccess=False, TrueValue="True")
round = Round(Number=division)  # -> Nearest, Floor, Ceiling
multiplication_2 = Multiplication(A=round.Nearest, B=mass_addition_2.Result)
subtraction_2 = Subtraction(A=multiplication, B=multiplication_2, C=number_slider)
gfa_difference = Panel(subtraction_2)
mass_addition_3 = MassAddition(Input=flatten([number_slider, multiplication_2]))  # -> Result, PartialResults
actual_gfa = Panel(mass_addition_3.Result)
no_of_floors_2 = Panel(round.Nearest)
to_3d = To3D(
    MarshallingSignalParameter=flatten([corridor_circulation_system.Building_, l_building_system.L_Buildings_]),
    _number_of_floor=no_of_floors_2)  # -> Building_, Preview_
programratio = GetString(AtLeast=1, AtMost=1, TreeAccess=True)
programarea = GetString(AtLeast=1, AtMost=1, TreeAccess=True)
unitrowslicingtype = GetBoolean(AtLeast=1, AtMost=1, FalseValue="False", TreeAccess=False, TrueValue="True")
unitdistributionshuffle = GetNumber(AtLeast=1, AtMost=1, Maximum=1.797693135e+308, Minimum=-1.797693135e+308, TreeAccess=False)
unit_distribution = UnitDistribution(
    MarshallingSignalParameter=to_3d.Building_,
    _unit_sizes=programarea,
    _unit_distribution=programratio,
    _unit_row_slicing_type=unitrowslicingtype,
    _unit_distribution_type=unitdistributiontype,
    _shuffle=unitdistributionshuffle)  # -> Building_, Preview_
context_print_3 = ContextPrint(NumberOfFloors=no_of_floors_2)
visualize_building = VisualizeBuilding(MarshallingSignalParameter=flatten(unit_distribution.Building_))  # -> Unit_geo_, Unit_color_, Corridor_geo_, Corridor_color_, flatten(Stair_Case_geo_), Stair_Case_color_, Amenity_Zone_geo_, Amenity_Zone_color_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
context_bake = ContextBake(UnitGeometry=visualize_building.Unit_geo_)
context_print_4 = ContextPrint(UnitColor=visualize_building.Unit_color_)
context_bake_2 = ContextBake(CorridorGeometry=visualize_building.Corridor_geo_)
context_print_5 = ContextPrint(CorridorColor=visualize_building.Corridor_color_)
context_bake_3 = ContextBake(StaircaseGeometry=visualize_building.Stair_Case_geo_)
context_print_6 = ContextPrint(StaircaseColor=visualize_building.Stair_Case_color_)
context_bake_4 = ContextBake(UnitMidPoint=visualize_building.Unit_mid_point_)
context_print_7 = ContextPrint(UnitArea=visualize_building.Unit_area_)
context_print_8 = ContextPrint(AreaTextColor=visualize_building.Area_text_color_)
